# Grasshopper definition export_from_karamba.gh (Grasshopper 1.0.7)
# plug-ins: karambaGH

number_slider = Slider(1, range=1..20)
panel = Panel("""-10, 0, 0
10,0,0""")
list_item = ListItem(List=panel, Index=0, Wrap=True)  # -> Item, Item1
construct_point = ConstructPoint(XCoordinate=0, YCoordinate=0, ZCoordinate=Slider(5, range=-10..10))
line = Line(StartPoint=list_item.Item1, EndPoint=construct_point)
line_2 = Line(StartPoint=list_item.Item, EndPoint=construct_point)
divide_curve = DivideCurve(Curve=line_2, Count=number_slider, Kinks=False)  # -> Points, Tangents, Parameters
divide_curve_2 = DivideCurve(Curve=line, Count=number_slider, Kinks=False)  # -> Points, Tangents, Parameters
shatter = Shatter(Curve=line_2, Parameters=divide_curve.Parameters)
shatter_2 = Shatter(Curve=line, Parameters=divide_curve_2.Parameters)
shift_list = ShiftList(List=divide_curve.Points, Shift=1, Wrap=False)
shift_list_2 = ShiftList(List=divide_curve_2.Points, Shift=1, Wrap=False)
remove_duplicate_points_karamba3d = RemoveDuplicatePointsKaramba3D(Point=[shift_list, shift_list_2], LimitDistance=0.005)  # -> OutPoint, Info, Indexes
curve = Curve(shatter_2)
curve_2 = Curve(shatter)
merge = Merge(Data1=list_item.Item, Data2=construct_point, Data3=list_item.Item1)
point = Point(construct_point)
live_load = Slider(-10, range=-50..-0.04)
number_slider_2 = Slider(12, range=0..100)

# ---- group: Define Loads
live_load_2 = Slider(-10, range=-50..-0.04)
unit_z = UnitZ(Factor=live_load_2)
unit_z_2 = UnitZ(Factor="-1")
loads_karamba3d = LoadsKaramba3D(Vector=unit_z_2, LCase=0, mode="Gravity")
loads_karamba3d_2 = LoadsKaramba3D(ForceVector=unit_z, Local=False, PosInd=point, LCase=0, mode="Point")
load_karamba3d = LoadKaramba3D(flatten(loads_karamba3d_2))

# ----
point_2 = Point(merge)
division = Division(A=number_slider_2, B=2)

# ---- group: Define Supports
point_3 = Point(remove_duplicate_points_karamba3d.OutPoint)
point_4 = Point(list_item.Item1)
point_5 = Point(list_item.Item)
support_karamba3d = SupportKaramba(PosInd=point_3, menu=[buttons(off, on, off, on, off, on)])
support_karamba3d_2 = SupportKaramba(PosInd=point_5, menu=[buttons(on, on, on, on, on, on)])
support_karamba3d_3 = SupportKaramba(PosInd=point_4, menu=[buttons(on, on, on, on, on, on)])
support_karamba3d_4 = SupportKaramba(flatten([support_karamba3d_2, support_karamba3d, support_karamba3d_3]))
support_karamba3d_5 = SupportKaramba(flatten([support_karamba3d_3, support_karamba3d_2]))

# ----
unit_y = UnitY(Factor=live_load)

beam_truss_bending = BooleanToggle(True)
beam_bending = BooleanToggle(True)
has_joint = BooleanToggle(False)

# ---- group: Define Elements
# an ideal truss has hinged joints and
#  members carry only axial loads
panel_2 = Panel("beams_truss")
line_to_beam_karamba3d = LineToBeamKaramba3D(Line=curve, Identifier=panel_2, New=True, Remove=True, LimitDistance_m=0.005, Bending=beam_truss_bending)  # -> Element, Points, Info

# an ideal truss has hinged joints and
#  members carry only axial loads
panel_3 = Panel("beams")
line_to_beam_karamba3d_2 = LineToBeamKaramba3D(Line=curve_2, Identifier=panel_3, New=True, Remove=True, LimitDistance_m=0.005, Bending=beam_bending)  # -> Element, Points, Info

# ----
cross_section_karamba3d = CrossSectionKaramba3D(
    FamilyNameOfCrossSection="Hey",
    NameOfCrossSection="Yo",
    ElementIdentifier=panel_2,
    Material=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,
    Diameter_cm=number_slider_2,
    WallThickness_cm=division,
    mode="Circular Hollow")
panel_4 = Panel(cross_section_karamba3d)

# ---- group: supports marked as grounded, to differentiate from "2D-stablizing" supports
support_karamba3d_6 = SupportKaramba(flatten(support_karamba3d_5))

# ----
merge_2 = Merge(Data1=line_to_beam_karamba3d_2.Element, Data2=line_to_beam_karamba3d.Element)
construct_point_2 = ConstructPoint(XCoordinate="0", YCoordinate=Slider(0, range=0..2), ZCoordinate="0")
construct_point_3 = ConstructPoint(XCoordinate="0", YCoordinate=Slider(0, range=0..2), ZCoordinate="0")
cross_section_karamba3d_2 = CrossSectionKaramba3D(
    FamilyNameOfCrossSection="DefaultCroSec",
    Material=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,
    Diameter_cm=11.43,
    WallThickness_cm=0.4,
    mode="Circular Hollow")
rhino_doc_dir = RhinoDocDir()  # -> rhino_doc_dir
# ---------- rhino_doc_dir: Python ----------
import scriptcontext as sc
from os import path

rhino_doc_dir = path.abspath(path.dirname(sc.doc.Path))
# ---------- end rhino_doc_dir ----------
text = Text(rhino_doc_dir)
panel_5 = Panel(text)
beam_joints_karamba3d = BeamJointsKaramba3D(
    ElementIdentifiers=panel_3,
    CtKNMAtStartingNode=Vector(0, 0, 0),
    CrKNmRadAtStartingNode=construct_point_2,
    CtKNMAtEndNode=Vector(0, 0, 0),
    CrKNmRadAtEndNode=construct_point_2,
    menu=[buttons(off, off, off, off, off, off), buttons(off, off, off, off, off, off)])
beam_joints_karamba3d_2 = BeamJointsKaramba3D(
    ElementIdentifiers=panel_2,
    CtKNMAtStartingNode=Vector(0, 0, 0),
    CrKNmRadAtStartingNode=construct_point_3,
    CtKNMAtEndNode=Vector(0, 0, 0),
    CrKNmRadAtEndNode=construct_point_3,
    menu=[buttons(off, off, off, off, off, off), buttons(off, off, off, off, on, off)])
stream_filter = StreamFilter(Gate=has_joint, Stream1=[beam_joints_karamba3d_2, beam_joints_karamba3d])

# ---- group: Assemble Model
assemble_model_karamba3d = AssembleModelKaramba(
    Point=point_2,
    Elem=merge_2,
    Support=support_karamba3d_4,
    Load=load_karamba3d,
    CrossSection=cross_section_karamba3d,
    Joint=stream_filter,
    LimitDistance_m=0.005)  # -> Model, Info, Mass_kg, CenterOfGravity

# ----
ghpython_script = GhPythonScript(x=rhino_doc_dir)  # -> out, a
# ---------- ghpython_script: Python ----------
import os

a = os.path.abspath(os.path.join(x,"..","..",".."))
# ---------- end ghpython_script ----------
disassemble_cross_section_karamba3d = DisassembleCrossSectionKaramba3D(CroSec=cross_section_karamba3d_2)  # -> CrossSection, FamilyNameOfCrossSection, TypeNameOfCrossSection, ElemIdentifiers, Color, Material, LocalEccentricity_cm, Heights_cm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
panel_6 = Panel(ghpython_script.a)
k_model = Slider(0, range=0..1)
format_json = BooleanToggle(True)
export_json = BooleanToggle(False)
concatenate = Concatenate(FragmentA="2D_truss", FragmentB=".json")
disassemble_cross_section_karamba3d_2 = DisassembleCrossSectionKaramba3D(CroSec=cross_section_karamba3d)  # -> CrossSection, FamilyNameOfCrossSection, TypeNameOfCrossSection, ElemIdentifiers, Color, Material, LocalEccentricity_cm, Heights_cm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
model_karamba3d = ModelKaramba3D(assemble_model_karamba3d.Model)
model_karamba3d_2 = ModelKaramba3D(assemble_model_karamba3d.Model)

# ---- group: json to karamba
ghpython_script_2 = GhPythonScript(conmech_dir=ghpython_script.a, save_dir=panel_5, file_name=concatenate)  # -> out, Model_out
# ---------- ghpython_script_2: Python ----------
import rhinoscriptsyntax as rs
import Rhino.Geometry.Plane as Plane
import Rhino.Geometry.Point3d as Point3d
import Rhino.Geometry.Vector3d as Vector3d
import Rhino.Geometry.Quaternion as Quat
import Grasshopper.DataTree as DataTree # Add, AddRange(list, GHPath(i, j))
import Grasshopper.Kernel.Data.GH_Path as GHPath
import System
from System.Collections.Generic import List

from ghpythonlib.treehelpers import list_to_tree, tree_to_list
import os
import json
##############################

import clr
# https://ironpython.net/documentation/dotnet/dotnet.html

try:
    clr.AddReferenceToFileAndPath("C:\Program Files\Rhino 6\Plug-ins\Karamba.gha")
    clr.AddReferenceToFileAndPath("C:\Program Files\Rhino 6\Plug-ins\KarambaCommon.dll")
except:
    try:
        clr.AddReferenceToFileAndPath("C:\Program Files\Rhino 6\Plug-ins\Karamba\Karamba.gha")
        clr.AddReferenceToFileAndPath("C:\Program Files\Rhino 6\Plug-ins\Karamba\KarambaCommon.dll")
    except:
        raise RuntimeError("Karamba Plug-in path (where Karamba.gha and KarambaCommon.dll resides) not found!")

import feb # Karamba's C++ library (undocumented in the API)
import Karamba.Models.Model as Model
import Karamba.GHopper.Models.GH_Model as GH_Model
#
import Karamba
import Karamba.Elements.ModelTruss as Truss
from Karamba.Geometry import Point3, Line3, Vector3
from Karamba.CrossSections import CroSec
from Karamba.Supports import Support
from Karamba.Loads import Load
#
from Karamba.Utilities import MessageLogger, UnitsConversionFactories
import KarambaCommon
#
import System
from System import GC
from System.Collections.Generic import List

#####################################
# add path to conmech script folder
import os, sys 
sys.path.append(os.path.join(conmech_dir, "src", "pyconmech", "frame_analysis"))
#from io_base import Model
import io_base
import karamba_io
reload(io_base)
reload(karamba_io)
from karamba_io import KarambaNode, KarambaElement, KarambaSupport, KarambaCrossSec, \
    KarambaMaterialIsotropic, KarambaModel
from io_base import LoadCase

#####################################

with open(os.path.join(save_dir, file_name), 'r') as f:
    data = json.load(f)

km = KarambaModel.from_data(data)
lc = LoadCase.from_data(data['loadcases']['0'])

model = km.to_karamba(lc)

# calculate Th.I response
logger = MessageLogger();
k3d = KarambaCommon.Toolkit();
max_disp = clr.Reference[List[float]]()
out_g = clr.Reference[List[float]]()
out_comp = clr.Reference[List[float]]()
message = clr.Reference[str]()
model = k3d.Algorithms.AnalyzeThI(model, max_disp, out_g, out_comp, message);

ucf = UnitsConversionFactories.Conv();
cm = ucf.cm();
print "max disp: {} {}".format(cm.toUnit(max_disp.Value[0]), cm.unitB)

Model_out = Karamba.GHopper.Models.GH_Model(model);

#from Karamba.GHopper.CrossSections import GH_CrossSection
#a = List[GH_CrossSection]([GH_CrossSection(cs.to_karamba()) for _, cs in km.crosssecs.items()])
# ---------- end ghpython_script_2 ----------

# ----
stream_filter_2 = StreamFilter(Gate=k_model, Stream0=assemble_model_karamba3d.Model, Stream1=ghpython_script_2.Model_out)

# ---- group: Analyze Model
analyze_karamba3d = AnalyzeKaramba3D(Model=stream_filter_2)  # -> CalculatedModel, MaximumDisplacement_cm, ResultingForceOfGravity_kN, ElasticEnergy_kNm
displacement = Panel(analyze_karamba3d.MaximumDisplacement_cm)

# ----
disassemble_model_karamba3d = DisassembleModelKaramba3D(Model=analyze_karamba3d.CalculatedModel)  # -> Model, Point, Beam, Shell, Support, Load, Line, Mesh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
panel_7 = Panel(disassemble_model_karamba3d.Beam)
panel_8 = Panel(analyze_karamba3d.ElasticEnergy_kNm)
model_karamba3d_3 = ModelKaramba3D(ghpython_script_2.Model_out)

# ---- group: karamba to json export
ghpython_script_3 = GhPythonScript(
    conmech_dir=ghpython_script.a,
    k_model=model_karamba3d,
    model_name="2D_truss",
    save_path=panel_5,
    export=export_json,
    format_json=format_json)  # -> out, a; inputs k_grounded_nodes: list
# ---------- ghpython_script_3: Python ----------
import rhinoscriptsyntax as rs
import Rhino.Geometry.Plane as Plane
import Rhino.Geometry.Point3d as Point3d
import Rhino.Geometry.Vector3d as Vector3d
import Rhino.Geometry.Quaternion as Quat
import Grasshopper.DataTree as DataTree # Add, AddRange(list, GHPath(i, j))
import Grasshopper.Kernel.Data.GH_Path as GHPath
import System
from System.Collections.Generic import List

from ghpythonlib.treehelpers import list_to_tree, tree_to_list
import os
import json
##############################

import clr
# https://ironpython.net/documentation/dotnet/dotnet.html

try:
    clr.AddReferenceToFileAndPath("C:\Program Files\Rhino 6\Plug-ins\Karamba.gha")
    clr.AddReferenceToFileAndPath("C:\Program Files\Rhino 6\Plug-ins\KarambaCommon.dll")
except:
    try:
        clr.AddReferenceToFileAndPath("C:\Program Files\Rhino 6\Plug-ins\Karamba\Karamba.gha")
        clr.AddReferenceToFileAndPath("C:\Program Files\Rhino 6\Plug-ins\Karamba\KarambaCommon.dll")
    except:
        raise RuntimeError("Karamba Plug-in path (where Karamba.gha and KarambaCommon.dll resides) not found!")

import feb # Karamba's C++ library (undocumented in the API)
import Karamba.Models.Model as Model
import Karamba.GHopper.Models.GH_Model as GH_Model
#
import Karamba
import Karamba.Elements.ModelTruss as Truss
from Karamba.Geometry import Point3, Line3, Vector3
from Karamba.CrossSections import CroSec
from Karamba.Supports import Support
from Karamba.Loads import Load
#
from Karamba.Utilities import MessageLogger, UnitsConversionFactories
import KarambaCommon
#
import System
from System import GC
from System.Collections.Generic import List

#####################################
# add path to conmech script folder
import os, sys 
sys.path.append(os.path.join(conmech_dir, "src", "pyconmech", "frame_analysis"))
#from io_base import Model
import io_base
import karamba_io
reload(io_base)
reload(karamba_io)
from karamba_io import KarambaModel, KarambaLoadCase

#####################################

k_model = KarambaModel.from_karamba(_k_model, grounded_supports=_k_grounded_nodes, \
    model_name=model_name, limit_distance=1e-6)

model_data = k_model.to_data()
lc = 0
k_loadcase = KarambaLoadCase.from_karamba(_k_model, lc=lc)
model_data['loadcases'] = {}
model_data['loadcases'][str(lc)] = k_loadcase.to_data()

with open(os.path.join(save_path, model_name + '.json'), "w") as outfile:
    json.dump(model_data, outfile, indent=1 if format_json else None)
# ---------- end ghpython_script_3 ----------

# ----
panel_9 = Panel(model_karamba3d)

# ---- group: directly call conmech sovler throu compas RPC Proxy
# https://compas.dev/compas/latest/api/generated/compas.rpc.Proxy.html#compas.rpc.Proxy
ghpython_script_4 = GhPythonScript(conmech_dir=ghpython_script.a, k_model=model_karamba3d, model_name="2D_truss")  # -> out, nodes, elements, nD, eR, fR, elastic_energy, sigma_max
# ---------- ghpython_script_4: Python ----------
import rhinoscriptsyntax as rs
import Rhino.Geometry.Plane as Plane
import Rhino.Geometry.Point3d as Point3d
import Rhino.Geometry.Vector3d as Vector3d
import Rhino.Geometry.Quaternion as Quat
import Grasshopper.DataTree as DataTree # Add, AddRange(list, GHPath(i, j))
import Grasshopper.Kernel.Data.GH_Path as GHPath
import System
from System.Collections.Generic import List

from ghpythonlib.treehelpers import list_to_tree, tree_to_list
import os
import json
##############################

import clr
# https://ironpython.net/documentation/dotnet/dotnet.html

try:
    clr.AddReferenceToFileAndPath("C:\Program Files\Rhino 6\Plug-ins\Karamba.gha")
    clr.AddReferenceToFileAndPath("C:\Program Files\Rhino 6\Plug-ins\KarambaCommon.dll")
except:
    try:
        clr.AddReferenceToFileAndPath("C:\Program Files\Rhino 6\Plug-ins\Karamba\Karamba.gha")
        clr.AddReferenceToFileAndPath("C:\Program Files\Rhino 6\Plug-ins\Karamba\KarambaCommon.dll")
    except:
        raise RuntimeError("Karamba Plug-in path (where Karamba.gha and KarambaCommon.dll resides) not found!")

import feb # Karamba's C++ library (undocumented in the API)
import Karamba.Models.Model as Model
import Karamba.GHopper.Models.GH_Model as GH_Model
#
import Karamba
import Karamba.Elements.ModelTruss as Truss
from Karamba.Geometry import Point3, Line3, Vector3
from Karamba.CrossSections import CroSec
from Karamba.Supports import Support
from Karamba.Loads import Load
#
from Karamba.Utilities import MessageLogger, UnitsConversionFactories
import KarambaCommon
#
import System
from System import GC
from System.Collections.Generic import List

#####################################
# add path to conmech script folder
import os, sys 
sys.path.append(os.path.join(conmech_dir, "src", "pyconmech", "frame_analysis"))
#from io_base import Model
import io_base
import karamba_io
reload(io_base)
reload(karamba_io)
from karamba_io import KarambaModel, KarambaLoadCase

#####################################

k_model = KarambaModel.from_karamba(_k_model, \
    model_name=model_name, limit_distance=1e-6)

k_loadcase = KarambaLoadCase.from_karamba(_k_model)

print k_model.joints

from compas.rpc import Proxy

cm_proxy = Proxy("pyconmech.frame_analysis")

rdata = cm_proxy.solve_linear_elastic_from_data(k_model.to_data(), k_loadcase.to_data())

print rdata.keys()

nodes = [Point3d(*n.point) for n in k_model.nodes]
elements = DataTree[int]()
for e in k_model.elements:
    elements.AddRange(e.end_node_inds, GHPath(int(e.elem_ind)))

nD = DataTree[float]()
for nid, nd in rdata['nodal_displacement'].items():
    nD.AddRange(nd, GHPath(int(nid)))

eR = DataTree[float]()
for eid, er in rdata['element_reaction'].items():
    eR.AddRange(er[0], GHPath(int(eid), 0))
    # negate so we have the correct diagram
    eR.AddRange([-v for v in er[1]], GHPath(int(eid), 1))
    
fR = DataTree[float]()
for nid, fr in rdata['support_reaction'].items():
    fR.AddRange(fr, GHPath(int(nid)))

elastic_energy = rdata['elastic_energy']

print rdata['sigma_max']
sigma_max = DataTree[float]()
for eid, s in rdata['sigma_max'].items():
    sigma_max.Add(s, GHPath(int(eid)))
# ---------- end ghpython_script_4 ----------
panel_10 = Panel(ghpython_script_4.out)

# ----
panel_11 = Panel(ghpython_script_4.elastic_energy)

# ---- group: showing local element axis
list_item_2 = ListItem(List=ghpython_script_4.elements, Index=0, Wrap=True)  # -> Item, Item1
panel_12 = Panel(ghpython_script_4.elements)
point_6 = Point(ghpython_script_4.nodes)
list_item_3 = ListItem(List=point_6, Index=list_item_2.Item, Wrap=True)
list_item_4 = ListItem(List=point_6, Index=list_item_2.Item1, Wrap=True)
vector_2pt = Vector2Pt(PointA=list_item_3, PointB=list_item_4, Unitize=False)  # -> Vector, Length
vector_display_ex = VectorDisplayEx(Point=list_item_3, Vector=vector_2pt.Vector, Colour=RGB(0, 0, 0), Width=Slider(4.1, range=2..10))
panel_13 = Panel(ghpython_script_4.eR)

# ----
disassemble_model_karamba3d_2 = DisassembleModelKaramba3D(Model=model_karamba3d_2)  # -> Model, Point, Beam, Shell, Support, Load, Line, Mesh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
panel_14 = Panel(model_karamba3d_2)
panel_15 = Panel(disassemble_cross_section_karamba3d_2.Area_cm2)
panel_16 = Panel(disassemble_cross_section_karamba3d_2.Iyy_cm4)
panel_17 = Panel(disassemble_cross_section_karamba3d_2.Izz_cm4)
panel_18 = Panel(disassemble_cross_section_karamba3d_2.Ipp_cm4)
panel_19 = Panel(disassemble_model_karamba3d_2.Beam)
panel_20 = Panel(disassemble_cross_section_karamba3d_2.Material)
disassemble_material_karamba3d = DisassembleMaterialKaramba3D(Material=disassemble_cross_section_karamba3d_2.Material)  # -> Material, TypeOfMaterial, FamilyNameOfMaterial, NameOfMaterial, ElemIdentifiers, Color, YoungsModulusKNCm2Dir12, InPlaneShearModulus_kN_cm2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
panel_21 = Panel(model_karamba3d_3)
panel_22 = Panel(ghpython_script_2.Model_out)
model_karamba3d_4 = ModelKaramba3D(analyze_karamba3d.CalculatedModel)

# ---- group: View Results
model_view_karamba3d = ModelViewKaramba3D(Model=analyze_karamba3d.CalculatedModel, LoadCaseFactorsForLinearSuperposition=1, IndexOfVisibleLoadcase=-1)  # -> Model, DeformedMesh, DeformedAxes, DeformedModel
beam_view_karamba3d = BeamViewKaramba3D(Model=model_view_karamba3d.Model)  # -> Model, MeshesOfRenderedBeams, DeformedBeamAxes, LegendColors, LegendTags
legend = Legend(Colour=beam_view_karamba3d.LegendColors, Tags=beam_view_karamba3d.LegendTags, LegendType=1)

# ---- group: Check Beam Internal Forces
# Element Reaction In local axis!
# -You can call a specific group of beams using
# the 'BeamIds' input.
# -Adding '3' to the resolution input provides values
# at the middle of each beam in addition to the
# two ends (default).
beam_forces_karamba3d = BeamForcesKaramba(AnalyzedModel=model_karamba3d_4, LCase=-1, MaximumDistanceBetweenResults_m=-1, NumberOfResultsPerBeamElement=2)  # -> AnalyzedModel, simplify(graft(NormalForce_kN)), simplify(graft(ShearForceVz_kN)), simplify(graft(ShearForceVy_kN)), simplify(graft(BendingMomentMt_kNm)), simplify(graft(BendingMomentMy_kNm)), simplify(graft(BendingMomentMz_kNm))

# ---- group: Check Beam Displacements
# Displacement, In global axis!
# -You can call a specific group of beams using
# the 'BeamIds' input.
# -Adding '3' to the resolution input provides values
# at the middle of each beam in addition to the
# two ends (default).
beam_displacements_karamba3d = BeamDisplacementsKaramba(AnalyzedModel=model_karamba3d_4, LoadCase=-1, MaximumDistanceBetweenResults_ft=-1, NumberOfResultsPerElement=2)  # -> AnalyzedModel, simplify(graft(Translations_ft)), simplify(graft(Rotations_rad))
concatenate_2 = Concatenate(FragmentA=beam_displacements_karamba3d.Translations_ft, FragmentB=beam_displacements_karamba3d.Rotations_rad)
panel_23 = Panel(concatenate_2)

# ----
beam_resultant_forces_karamba3d = BeamResultantForcesKaramba3D(AnalyzedModel=model_karamba3d_4, LoadCase=-1, MaximumProbingDistance_m=-1, NumberOfProbingPointsPerElement=3)  # -> AnalyzedModel, NormalForce_kN, ResultantBendingMoment_kNm, ResultantShearForce_kN
utilization_of_elements_karamba3d = UtilizationOfElementsKaramba3D(
    AnalyzedModel=model_karamba3d_4,
    ResultCase=-1,
    NumberOfSamplePoints=3,
    ElasticDesign=True,
    GammaM0=1,
    GammaM1=1,
    WithDetails=False,
    mode="Beams")  # -> AnalyzedModel, Utilization, SigMax_kN_cm2, SigMin_kN_cm2, TauMax_kN_cm2, UtilN, UtilVy, UtilVz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

# ----
# Support Reaction
reaction_forces_karamba3d = ReactionForcesKaramba3D(AnalyzedModel=model_karamba3d_4, ResultCase=0)  # -> AnalyzedModel, simplify(graft(ReactionForces_kN)), simplify(graft(ReactionMoments_kNm)), SupportPosition, SumOfReactionForces_kN, SumOfReactionMoments_kNm
panel_24 = Panel(reaction_forces_karamba3d.SumOfReactionForces_kN)
panel_25 = Panel(reaction_forces_karamba3d.SumOfReactionMoments_kNm)
panel_26 = Panel(reaction_forces_karamba3d.ReactionForces_kN)
panel_27 = Panel(reaction_forces_karamba3d.ReactionMoments_kNm)

panel_28 = Panel(utilization_of_elements_karamba3d.SigMin_kN_cm2)
panel_29 = Panel(utilization_of_elements_karamba3d.SigMax_kN_cm2)
panel_30 = Panel(utilization_of_elements_karamba3d.TauMax_kN_cm2)
panel_31 = Panel(beam_resultant_forces_karamba3d.ResultantBendingMoment_kNm)
panel_32 = Panel(beam_resultant_forces_karamba3d.ResultantShearForce_kN)
concatenate_3 = Concatenate(
    Fragment_A=beam_forces_karamba3d.NormalForce_kN,
    C=" | ",
    Fragment_B=beam_forces_karamba3d.ShearForceVy_kN,
    A=" | ",
    B=beam_forces_karamba3d.ShearForceVz_kN,
    E=" | ",
    D=beam_forces_karamba3d.BendingMomentMt_kNm,
    F=" | ",
    G=beam_forces_karamba3d.BendingMomentMy_kNm,
    H=" | ",
    I=beam_forces_karamba3d.BendingMomentMz_kNm)
division_2 = Division(A=ghpython_script_4.sigma_max, B=100000)
panel_33 = Panel(division_2)
element_reaction = Panel(concatenate_3)
concatenate_4 = Concatenate(FragmentA=reaction_forces_karamba3d.ReactionForces_kN, FragmentB=panel_27)
list_item_5 = ListItem(List=ghpython_script_4.eR, Index=0, Wrap=True)  # -> Item, Item1, Item2, Item3, Item4, Item5
panel_34 = Panel(ghpython_script_4.nD)
concatenate_5 = Concatenate(
    Fragment_A=list_item_5.Item,
    C=" | ",
    Fragment_B=list_item_5.Item1,
    A=" | ",
    B=list_item_5.Item2,
    E=" | ",
    D=list_item_5.Item3,
    F=" | ",
    G=list_item_5.Item4,
    H=" | ",
    I=list_item_5.Item4)
support_reaction = Panel(concatenate_4)
conmech_element_reaction = Panel(concatenate_5)
panel_35 = Panel(ghpython_script_4.fR)
