# Grasshopper definition stiffness_checker_compare_karamba.ghx (Grasshopper 1.0.7)
# plug-ins: Karamba

panel = Panel("C:\Users\harry\Documents\pb-construction\conmech\tests\gh_scripts")
concatenate = Concatenate(Fragment_A=panel, A="\", Fragment_B="voronoi_analysis_res.json")
concatenate_2 = Concatenate(Fragment_A=panel, A="\", Fragment_B="voronoi_solution.json")
python = PythonScript()  # -> rhino_doc_dir
# ---------- python: Python ----------
import scriptcontext as sc
from os import path

rhino_doc_dir = path.abspath(path.dirname(sc.doc.Path))
# ---------- end python ----------

# ----
# file name
panel_2 = Panel("topopt-100.json")

ghpython_script = GhPythonScript(seq_result_file_path=concatenate_2)  # -> out, seq_e_ids; disabled
# ---------- ghpython_script: Python ----------
__author__ = "harry"
__version__ = "2019.08.22"

import rhinoscriptsyntax as rs
import json

with open(seq_result_file_path, 'r') as f:
    json_data = json.loads(f.read())

seq_e_ids = json_data['plan']
del json_data['plan']
print(json_data)
# ---------- end ghpython_script ----------
panel_3 = Panel("C:\Users\harry\Documents\pb-construction\conmech\tests\assembly_instances\extrusion")
panel_4 = Panel("C:\Users\harry\Documents\pb-construction\conmech\tests\test_data")
list = ValueList({"CRITICAL", "ERROR", "WARNING", "INFO", "DEBUG", "NOTSET"}, selected="DEBUG")

# ---- group: Import remote python modules
panel_5 = Panel(python)
# Turn me on!   -->
panel_6 = Panel("""numpy
numpy.linalg
pyconmech.frame_analysis""")
ghpythonremote = GHPythonRemote(location="conda://py2", run=Toggle(False), modules=panel_6, log_level=list, working_dir=panel_5)  # -> out, linked_modules, rpy; inputs run: Boolean, modules: list
# ---------- ghpythonremote: Python ----------
import sys
import scriptcontext
import logging
import inspect
import ghpythonremote
from ghpythonremote.connectors import GrasshopperToPythonRemote
from os import path
from time import sleep

local_log_level = getattr(logging, log_level, logging.WARNING)
logger = logging.getLogger('ghpythonremote')
logger.setLevel(local_log_level)
ch = logging.StreamHandler()
ch.setLevel(local_log_level)
formatter = logging.Formatter('%(levelname)s: %(name)s:\n%(message)s')
ch.setFormatter(formatter)
logger.handlers = []
logger.addHandler(ch)
logger = logging.getLogger('ghpythonremote.GH_to_python_sticky')

ROOT = path.abspath(path.dirname(inspect.getfile(ghpythonremote)))
rpyc_server_py = path.join(ROOT, 'pythonservice.py')

# Set connection to CLOSED if this is the first run
# and initialize set of linked modules
try:
    remote_python_status
except NameError:
    remote_python_status = 'CLOSED'
    lkd_modules = set()

# Wait for connection to connect or terminate
timer = 0
while remote_python_status == 'CONNECTING' or remote_python_status == 'CLOSING':
    sleep(1)
    timer += 1
    if timer == 10:
        try:
            gh2py_manager.__exit__(*sys.exc_info())
        except Exception:
            pass
        remote_python_status = 'CLOSED'
        lkd_modules = set()
        raise RuntimeError("Connection left in an inconsistent state and not returning. Reset everything.")

if run:
    if not remote_python_status == 'OPEN':
        remote_python_status = 'CONNECTING'
        gh2py_manager = GrasshopperToPythonRemote(rpyc_server_py, location=location, timeout=10,
                                                  port=None, log_level=log_level, working_dir=working_dir)
        gh2py = gh2py_manager.__enter__()
        remote_python_status = 'OPEN'

    # Stuff that we can reach
    rpymod = gh2py.py_remote_modules  # A getter function for a named python module
    rpy = gh2py.connection  # Represents the remote instance root object
    scriptcontext.sticky['rpy'] = rpy
    # Add modules
    for mod in modules:
        try:
            scriptcontext.sticky[mod] = rpymod(mod)
            lkd_modules.add(mod)
        except ImportError:
            gh2py_manager.__exit__(*sys.exc_info())
            raise

elif not remote_python_status == 'CLOSED':
    remote_python_status = 'CLOSING'
    # Remove linked modules
    for mod in lkd_modules:
        del scriptcontext.sticky[mod]
    del scriptcontext.sticky['rpy']
    gh2py_manager.__exit__(*sys.exc_info())
    lkd_modules = set()
    remote_python_status = 'CLOSED'

# Change variable name because ghpython resets outputs to None before each run
linked_modules = lkd_modules

logger.info('GH to python connection is {}'.format(remote_python_status))
# ---------- end ghpythonremote ----------
panel_7 = Panel(ghpythonremote.out)

# ----
python_2 = PythonScript(module_names=ghpythonremote.linked_modules)  # -> import_statements; inputs module_names: list
# ---------- python_2: Python ----------
import_statements = ["import scriptcontext as sc"]
for module_name in module_names:
    import_statements.append("{0} = sc.sticky['{0}']".format(module_name))

if len(module_names) == 0:
    import_statements = []
# ---------- end python_2 ----------
integer = Integer(ghpython_script.seq_e_ids)
concatenate_3 = Concatenate(Fragment_A=panel_4, A="\", Fragment_B="tower_3D.json")
panel_8 = Panel(python_2)
split_list = SplitList(List=integer, Index=Slider(1, range=1..306))  # -> flatten(ListA), ListB
ghpython_script_2 = GhPythonScript(frame_json_file_path=concatenate_3, scale=Slider(1, range=0..1000))  # -> out, simplify(all_element_ids), all_nodes, all_elements, existing_elements, fix_node_ids, material_name, E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; inputs existing_ids: list of Int32
# ---------- ghpython_script_2: Python ----------
import rhinoscriptsyntax as rs
import Rhino.Geometry as rg
from Grasshopper import DataTree as datatree
from Grasshopper.Kernel.Data import GH_Path as ghpath
import System

from ghpythonlib.treehelpers import list_to_tree
#from compas.rpc import Proxy
#cm = Proxy('pyconmech.frame_analysis.stiffness_solve_fn')

import scriptcontext as sc
cm = sc.sticky['pyconmech.frame_analysis']
numpy = sc.sticky['numpy']
numpy.linalg = sc.sticky['numpy.linalg']

def rvector2list(rv):
    return [rv.X, rv.Y, rv.Z]


frame_info = cm.read_frame_json(frame_json_file_path)

node_points, element_vids, _fix_node_ids, fix_specs, model_type, material_dict, model_name = frame_info

all_nodes = [rs.CreatePoint(scale*pt[0], scale*pt[1], scale*pt[2]) for pt in node_points]
all_elements = [rg.Line(all_nodes[n1], all_nodes[n2]) for n1, n2 in element_vids]
existing_elements = [rg.Line(all_nodes[element_vids[e_id][0]], all_nodes[element_vids[e_id][1]]) for e_id in existing_ids]

fix_node_ids = [int(v) for v in _fix_node_ids]

material_name = material_dict['material_name']
E = material_dict['youngs_modulus']
E_unit = material_dict['youngs_modulus_unit']

G = material_dict['shear_modulus']
G_unit = material_dict['shear_modulus_unit']

if 'tensile_yeild_stress' in material_dict:
    sigma = material_dict['tensile_yeild_stress']
    sigma_unit = material_dict['tensile_yeild_stress_unit']

rho = material_dict['density']
rho_unit = material_dict['density_unit']

r = material_dict['radius']
r_unit = material_dict['radius_unit']
# ---------- end ghpython_script_2 ----------
list_length = ListLength(List=ghpython_script_2.all_elements)
series = Series(Start=0, Step=1, Count=list_length)  # -> flatten(Series)
ghpython_script_3 = GhPythonScript(frame_json_file_path=concatenate_3, result_file_path=concatenate, existing_ids=series, include_sw=Toggle(True))  # -> out, solve_success, element_reaction, local_coordinate_frames; inputs existing_ids: list of Int32, include_sw: Boolean
# ---------- ghpython_script_3: Python ----------
import rhinoscriptsyntax as rs
import Rhino.Geometry as rg
from Grasshopper import DataTree as datatree
from Grasshopper.Kernel.Data import GH_Path as ghpath
import System
import os
import json

from ghpythonlib.treehelpers import list_to_tree
#from compas.rpc import Proxy
#cm = Proxy('pyconmech.frame_analysis.stiffness_solve_fn')

import scriptcontext as sc
cm = sc.sticky['pyconmech.frame_analysis']
#numpy = sc.sticky['numpy']
#numpy.linalg = sc.sticky['numpy.linalg']

cm.stiffness_checker_parse_file_and_save_result(frame_json_file_path, result_file_path, existing_ids=existing_ids, include_sw=include_sw)

assert os.path.exists(result_file_path) and "json file path does not exist!"
with open(result_file_path, 'r') as f:
    json_data = json.loads(f.read())


solve_success = json_data['solve_success']

print('trans tol : {}, rot_tol : {}'.format(json_data['trans_tol'], json_data['rot_tol']))

er_tree = datatree[System.Double]()
local_planes = datatree[System.Double]()

for er_data in json_data['element_reaction']:
    e_id = er_data['element_id']
    for val in er_data['reaction']['0']:
        er_tree.Add(val, ghpath(e_id, 0))
    for val in er_data['reaction']['1']:
        er_tree.Add(val, ghpath(e_id, 1))
    e_LG = er_data['local_to_global_transformation']
    for i in range(3):
        for j in range(3):
            num = e_LG[j][i]
            local_planes.Add(num, ghpath(e_id, j))

element_reaction = er_tree
local_coordinate_frames = local_planes
# ---------- end ghpython_script_3 ----------
integer_2 = Integer(series)
panel_9 = Panel(ghpython_script_3.out)
concatenate_4 = Concatenate(B="{", Fragment_A=integer_2, A=";", Fragment_B="1", C="}")
concatenate_5 = Concatenate(B="{", Fragment_A=integer_2, A=";", Fragment_B="0", C="}")
number = Number(ghpython_script_3.local_coordinate_frames)
curve = Curve(reparameterize(simplify(graft(ghpython_script_2.all_elements))))
data = Data(ghpython_script_2.G_unit)
data_2 = Data(ghpython_script_2.material_name)
data_3 = Data(ghpython_script_2.E)
data_4 = Data(ghpython_script_2.G)
data_5 = Data(ghpython_script_2.E_unit)
data_6 = Data(ghpython_script_2.r)
data_7 = Data(ghpython_script_2.sigma)
data_8 = Data(ghpython_script_2.rho)
data_9 = Data(ghpython_script_2.sigma_unit)
data_10 = Data(ghpython_script_2.rho_unit)
data_11 = Data(ghpython_script_2.r_unit)
panel_10 = Panel(data_3)
panel_11 = Panel(data_4)
panel_12 = Panel(data_5)
panel_13 = Panel(data_11)
panel_14 = Panel(data_10)
panel_15 = Panel(data_2)
panel_16 = Panel(data)
panel_17 = Panel(data_7)
panel_18 = Panel(data_8)
panel_19 = Panel(data_9)
panel_20 = Panel(data_6)
split_tree = SplitTree(Data=number, Masks=flatten(concatenate_4))  # -> Positive, Negative
split_tree_2 = SplitTree(Data=number, Masks=flatten(concatenate_5))  # -> Positive, Negative
list_item = ListItem(List=ghpython_script_3.element_reaction, Index=0, Wrap=True)
panel_21 = Panel(ghpython_script_3.element_reaction)
split_tree_3 = SplitTree(Data=list_item, Masks=flatten("{*;0}"))  # -> Positive, Negative
list_item_2 = ListItem(List=split_tree.Positive, Index=0, Wrap=True)  # -> Item, Item1, Item2
list_item_3 = ListItem(List=split_tree_2.Positive, Index=0, Wrap=True)  # -> Item, Item1, Item2
construct_path = ConstructPath(Indices=simplify(graft(integer_2)))  # -> flatten(Branch)
evaluate_curve = EvaluateCurve(Curve=curve, Parameter=Slider(0.5, range=0..1))  # -> Point, Tangent, Angle
material_properties_karamba3d = MaterialPropertiesKaramba3D(
    FamilyOfMaterial=panel_15,
    Name="0",
    YoungsModulus_kN_cm2=panel_10,
    InPlaneShearModulus_kN_cm2=panel_11,
    TransverseShearModulus_kN_cm2=panel_11,
    SpecificWeight_kN_m3=panel_18,
    CoefficientOfThermalExpansion_1_C=1e-05,
    YieldStrength_kN_cm2=panel_17,
    mode="Isotrop")
material_properties_karamba3d_2 = MaterialPropertiesKaramba3D(
    FamilyOfMaterial="Steel",
    Name="S235",
    YoungsModulus_kN_cm2=21000,
    InPlaneShearModulus_kN_cm2=8076,
    TransverseShearModulus_kN_cm2=8076,
    SpecificWeight_kN_m3=78.5,
    CoefficientOfThermalExpansion_1_C=1e-05,
    YieldStrength_kN_cm2=23.5,
    mode="Isotrop")
vector_xyz = VectorXYZ(XComponent=list_item_2.Item, YComponent=list_item_2.Item1, ZComponent=list_item_2.Item2)  # -> simplify(Vector), Length
vector_xyz_2 = VectorXYZ(XComponent=list_item_3.Item, YComponent=list_item_3.Item1, ZComponent=list_item_3.Item2)  # -> simplify(Vector), Length
panel_22 = Panel(ghpython_script_3.local_coordinate_frames)
shift_paths = ShiftPaths(Data=split_tree_3.Positive, Offset=-1)
tree_statistics = TreeStatistics(Tree=shift_paths)  # -> Paths, Length, Count
split_tree_4 = SplitTree(Data=evaluate_curve.Point, Masks=flatten(construct_path))  # -> Positive, Negative
curve_2 = Curve(curve)
panel_23 = Panel(material_properties_karamba3d)
panel_24 = Panel(material_properties_karamba3d_2)
split_tree_5 = SplitTree(Data=curve_2, Masks=flatten(tree_statistics.Paths))  # -> Positive, Negative
point = Point(split_tree_4.Positive)

# ----
# all nodes
point_2 = Point(ghpython_script_2.all_nodes)

integer_3 = Integer(ghpython_script_2.fix_node_ids)

# ----
# all elements
curve_3 = Curve(ghpython_script_2.all_elements)

curve_4 = Curve(flatten(split_tree_5.Positive))
number_2 = Number(flatten(shift_paths))
construct_plane = ConstructPlane(Origin=point, XAxis=vector_xyz_2.Vector, YAxis=vector_xyz.Vector)

# ----
# element id shower
curve_5 = Curve([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])
entwine = Entwine(Branch00=curve_5, FlattenInputs=True)
c_script = CSharpScript(model=curve_3, layers=entwine)  # -> out, A, edge_layer_list; inputs model: list of Curve, layers: tree of Curve
# ---------- c_script: C# usings ----------
using System.IO;
using System.Linq;
using System.Data;
using System.Drawing;
using System.Reflection;
using System.Windows.Forms;
using System.Xml;
using System.Xml.Linq;
using System.Runtime.InteropServices;

using Rhino.DocObjects;
using Rhino.Collections;
using GH_IO;
using GH_IO.Serialization;
# ---------- c_script: C# ----------
    DataTree<int> index_tree = new DataTree<int>();
    List<int> edge_layer = new List<int>(new int[model.Count()]);

    foreach(var path in layers.Paths)
    {
      foreach(var line in layers.Branch(path.Indices))
      {
        for(int i = 0; i < model.Count(); i++)
        {
          var compare_line = model[i];

          if(line.PointAt(0) == compare_line.PointAt(0))
          {
            if(line.PointAt(1) == compare_line.PointAt(1))
            {
              index_tree.Add(i, path);
              edge_layer[i] = path.Indices[0];
              //              GH_Path p = new GH_Path(0);
              //              p.Indices
              continue;
            }
          }

          if(line.PointAt(0) == compare_line.PointAt(1))
          {
            if(line.PointAt(1) == compare_line.PointAt(0))
            {
              index_tree.Add(i, path);
              edge_layer[i] = path.Indices[0];
              continue;
            }
          }
        }
      }
    }

    A = index_tree;
    edge_layer_list = edge_layer;
# ---------- end c_script ----------

# ----
# at node 0,
# force > 0 tension
# force < 0 compression
panel_25 = Panel("0")
larger_than = LargerThan(FirstNumber=number_2, SecondNumber=panel_25)  # -> LargerThan, OrEqualTo
dispatch = Dispatch(List=curve_4, DispatchPattern=larger_than.LargerThan)  # -> ListA, ListB

list_item_4 = ListItem(List=point_2, Index=integer_3, Wrap=True)
panel_26 = Panel(c_script.A)
list_item_5 = ListItem(List=curve_3, Index=c_script.A, Wrap=True)
ghpython_script_4 = GhPythonScript(x=panel_26)  # -> out, a; inputs x: list
# ---------- ghpython_script_4: Python ----------
__author__ = "harry"
__version__ = "2019.08.22"

import rhinoscriptsyntax as rs

print([int(v) for v in x])
# ---------- end ghpython_script_4 ----------
point_3 = Point(point_2)
curve_6 = Curve(dispatch.ListB)
number_slider = Slider(256, range=0..256)
curve_7 = Curve(dispatch.ListA)

# ----
# grounded nodes
point_4 = Point(list_item_4)

colour_rgb = ColourRGB(Alpha=255, Red=0, Green=0, Blue=number_slider)
colour_rgb_2 = ColourRGB(Alpha=255, Red=number_slider, Green=0, Blue=0)

# ----
# Point load
point_5 = Point()
c_script_2 = CSharpScript(pts=point_3, target_pts=point_5, dist_tol=0.001)  # -> out, A; inputs pts: list of Point3d, target_pts: list of Point3d, dist_tol: Double
# ---------- c_script_2: C# ----------
    List<int> id = new List<int>();

    foreach(Point3d t_pt in target_pts)
    {
      for(int i = 0; i < pts.Count(); i++)
      {
        if(t_pt.DistanceTo(pts[i]) < dist_tol)
        {
          id.Add(i);
          break;
        }
      }
    }

    A = id;
# ---------- end c_script_2 ----------
integer_4 = Integer(c_script_2.A)
panel_27 = Panel("""0.0, 11.125, 0.0
0.0, 11.125, 0.0
222.5, 0, -111.25
222.5, 0, -111.25""")
list_item_6 = ListItem(List=point_3, Index=integer_4, Wrap=True)
vector = Vector(panel_27)
point_6 = Point(list_item_6)
panel_28 = Panel(vector)
vector_display = VectorDisplay(Anchor=point_6, Vector=vector)
loads_karamba3d = LoadsKaramba3D(ForceVector=vector, Local=False, PosInd=point_6, LCase="0", mode="Point")  # -> flatten(Load)

custom_preview = CustomPreview(Geometry=curve_7, Material=colour_rgb)
custom_preview_2 = CustomPreview(Geometry=curve_6, Material=colour_rgb_2)

# ----
# Supports
point_7 = Point(point_4)
support_karamba3d = SupportKaramba3D(PosInd=point_7, menu=[buttons(on, on, on, on, on, on)])
support_karamba3d_2 = SupportKaramba3D(support_karamba3d)

number_3 = Number(panel_20)
radius_cm = Panel(number_3)

# ----
# Gravity load
unit_z = UnitZ(Factor=1)
negative = Negative(Value=unit_z)
loads_karamba3d_2 = LoadsKaramba3D(Vector=negative, LCase=0, mode="Gravity")  # -> flatten(Load)

multiplication = Multiplication(A=number_3, B="2")
curve_8 = Curve(curve_3)
cross_section_karamba3d = CrossSectionKaramba3D(
    FamilyNameOfCrossSection="DefaultCroSec",
    Material=material_properties_karamba3d,
    Diameter_cm=multiplication,
    WallThickness_cm=number_3,
    mode="Circular Hollow")
point_8 = Point(point_3)
line_to_beam_karamba3d = LineToBeamKaramba3D(Line=curve_8, CrossSection=cross_section_karamba3d, Points=point_8, New=True, Remove=True, LimitDistance_m=0.005)  # -> Element, Points, Info
load_karamba3d = LoadKaramba3D(loads_karamba3d_2)
assemble_model_karamba3d = AssembleModelKaramba3D(
    Point=point_8,
    Elem=line_to_beam_karamba3d.Element,
    Support=support_karamba3d_2,
    Load=load_karamba3d,
    Material=material_properties_karamba3d,
    LimitDistance_m=0.005)  # -> Model, Info, Mass_kg, CenterOfGravity
analyze_karamba3d = AnalyzeKaramba3D(Model=assemble_model_karamba3d.Model)  # -> CalculatedModel, MaximumDisplacement_cm, ResultingForceOfGravity_kN, ElasticEnergy_kNm
reaction_forces_karamba3d = ReactionForcesKaramba3D(AnalyzedModel=analyze_karamba3d.CalculatedModel, LoadCase=0)  # -> AnalyzedModel, ReactionForces_kN, ReactionMoments_kNm, SupportPosition, SumOfReactionForces_kN, SumOfReactionMoments_kNm
beam_forces_karamba3d = BeamForcesKaramba3D(
    AnalyzedModel=analyze_karamba3d.CalculatedModel,
    LCase=-1,
    MaximumDistanceBetweenResults_m=-1,
    NumberOfResultsPerBeamElement=2)  # -> AnalyzedModel, NormalForce_kN, ShearForceVz_kN, ShearForceVy_kN, BendingMomentMt_kNm, BendingMomentMy_kNm, BendingMomentMz_kNm
nodal_displacements_karamba3d = NodalDisplacementsKaramba3D(AnalyzedModel=analyze_karamba3d.CalculatedModel, LoadCase=0)  # -> AnalyzedModel, NodalTranslations_m, NodalRotations_rad
deconstruct = Deconstruct(Point=simplify(graft(reaction_forces_karamba3d.ReactionForces_kN)))  # -> XComponent, YComponent, ZComponent
deconstruct_2 = Deconstruct(Point=simplify(graft(reaction_forces_karamba3d.ReactionMoments_kNm)))  # -> XComponent, YComponent, ZComponent
merge = Merge(
    Data1=simplify(graft(nodal_displacements_karamba3d.NodalTranslations_m)),
    Data2=simplify(graft(nodal_displacements_karamba3d.NodalRotations_rad)))
merge_2 = Merge(
    Data1=deconstruct.XComponent,
    Data2=deconstruct.YComponent,
    Data3=deconstruct.ZComponent,
    Data4=deconstruct_2.XComponent,
    Data5=deconstruct_2.YComponent,
    Data6=deconstruct_2.ZComponent)
merge_3 = Merge(
    Data1=graft(beam_forces_karamba3d.NormalForce_kN),
    Data2=graft(beam_forces_karamba3d.ShearForceVz_kN),
    Data3=graft(beam_forces_karamba3d.ShearForceVy_kN),
    Data4=graft(beam_forces_karamba3d.BendingMomentMt_kNm),
    Data5=graft(beam_forces_karamba3d.BendingMomentMy_kNm),
    Data6=graft(beam_forces_karamba3d.BendingMomentMz_kNm))  # -> simplify(Result)
evaluate = Evaluate(Expression="format(\"{0:E} {1:E} {2:E}\",x.x,x.y,x.z)", x=merge)
evaluate_2 = Evaluate(Expression="format(\"{0:E}\",x)", x=merge_2)
evaluate_3 = Evaluate(Expression="format(\"{0:E}\",x)", x=merge_3)
cluster = Cluster(text=evaluate, separators=" ")
reaction_force_kn_reaction_moment_kn_m = Panel(evaluate_2)
shift_paths_2 = ShiftPaths(Data=cluster, Offset=-1)
froce_kn_moment_kn_m = Panel(evaluate_3)
model_view_karamba3d = ModelViewKaramba3D(Model=analyze_karamba3d.CalculatedModel, LoadCaseFactorsForLinearSuperposition=1, IndexOfVisibleLoadcase=-1)  # -> Model, DeformedMesh, DeformedAxes, DeformedModel
beam_view_karamba3d = BeamViewKaramba3D(Model=model_view_karamba3d.Model)  # -> Model, MeshesOfRenderedBeams, DeformedBeamAxes, LegendColors, LegendTags
legend = Legend(Colour=beam_view_karamba3d.LegendColors, Tags=beam_view_karamba3d.LegendTags, LegendType=1)

# ==== cluster Cluster
text = ClusterInput()
separators = ClusterInput()
text_split = TextSplit(Text=text, Separators=separators)
number = Number(text_split)
clean_tree = CleanTree(RemoveNulls=True, RemoveInvalid=True, RemoveEmpty=False, Tree=number)
tree = ClusterOutput(clean_tree)
